# Grasshopper definition ConversionTool_JacquardLoom_withreset.gh (Grasshopper 1.0.8)
# plug-ins: Human UI

# ----
# Step 1: upload wif file
panel = Panel("Step 1: Upload .wif file below")
filepicker = CreateFilePicker(ButtonLabelText="Upload your .wif file", DialogType=0, MustExist=True, Filter="All Files|*.*")
label = CreateLabel(LabelText=panel, LabelSize=12, Justification=0)
separator = CreateSeparator(Thickness="15", Horizontal=True, Color=RGBA(0, 0, 0, 0))
values = ValueListener(Elements=filepicker, SomeProperty=True)  # -> Values, Indices
merge = Merge(Data1=label, Data2=filepicker, Data3=separator)

# ----
# Pattern input
# Input pattern here
path = FilePath(values.Values)

# ----
# Step 3: Choose saving location
panel_2 = Panel("Set file name and location")
filepicker_2 = CreateFilePicker(ButtonLabelText=panel_2, DialogType=1, MustExist=Toggle(False), Filter="G-code bestanden|*.gcode")
label_2 = CreateLabel(LabelText="Step 3: Set file name and location", LabelSize=12, Justification=0)
merge_2 = Merge(Data1=label_2, Data2=filepicker_2)

# ----
# Transform pattern to binary code
py3 = Python3Script(path=path)  # -> out, binary_rows
# ---------- py3: Python ----------
# ================================
# GhPython: WIF -> binary lift plan
# ================================

# INPUT:  path (string)
# OUTPUT: binary_rows (DataTree of ints — one branch per weaving row)


#Allow to create grasshopper branches
from Grasshopper import DataTree
from Grasshopper.Kernel.Data import GH_Path

#Create empty data tree
binary_rows = DataTree[object]()


try: #error protection, prevents grasshopper from crashing if sth goes wrong
#read wif file
    with open(path, 'r') as wif_file:
        lines = wif_file.readlines()

#Cleans file to read only useful info, remove comments etc
    lines = [l.strip() for l in lines if l.strip() and not l.startswith(';')]

    # Parse sections, turn file into python readable file
    sections = {}
    current = None
    for line in lines: #process file line by line
        if line.startswith('[') and line.endswith(']'): #detect section headers in wif file
            current = line[1:-1].upper() #extract section name, remove brackets, standardise name in uppercase
            sections[current] = [] #create list to store the lines
        elif current: #check whats already inside
            sections[current].append(line) #adds line to the section list

    # Total warps, extract number of warps
    warp_count = 0
    for line in sections.get('WARP', []): #get number of warp threads
        if line.lower().startswith('threads='): #detect thread count
            warp_count = int(line.split('=')[1].strip()) #extract numbers
            break

    # THREADING: connect warp thread to heddle
    threading_dict = {}
    for line in sections.get('THREADING', []):
        if '=' in line:
            key, val = line.split('=')
            threading_dict[int(key)] = int(val)

# convert threading dictionary to list
    threading = [threading_dict.get(i, 0) for i in range(1, warp_count + 1)] 

    # TREADLING: row sequence, create a sequence for each row
    treadling_dict = {}
    for line in sections.get('TREADLING', []):
        if '=' in line:
            key, val = line.split('=')
            treadling_dict[int(key)] = int(val)

    treadling_keys = sorted(treadling_dict.keys()) #sort rows
    treadling = [treadling_dict[k] for k in treadling_keys] #create sequence

    # TIEUP: treadle -> lifted heddles
    tieup = {}
    for line in sections.get('TIEUP', []):
        if '=' in line:
            key, val = line.split('=')
            tieup[int(key)] = [int(x) for x in val.split(',')]

    # Build binary lift plan, one branch per row
    for i, treadle in enumerate(treadling):
        lifted_heddles = tieup.get(treadle, [])
        row = [1 if threading[j] in lifted_heddles else 0 for j in reversed(range(warp_count))]
        binary_rows.AddRange(row, GH_Path(i))

#error handling to prevent Grasshopper from crashing if error occurs
except Exception as e:
    binary_rows.Add("Error: " + str(e), GH_Path(0))
# ---------- end py3 ----------
# Select lines
panel_3 = Panel(py3.binary_rows)

toggle = BooleanToggle(True)

# ----
# This can be changed if another size lever or less heddles
# are used to set the amount of levers and their locations
number_slider = Slider(60, range=0..100)

# ----
# Location and amount of warp threads
pt = ConstructPoint(XCoordinate=0, YCoordinate=0, ZCoordinate=0)
starting_point = Point(pt)
series = Series(Start=starting_point, Step="4.1", Count=number_slider)
panel_4 = Panel(series)
pt_2 = ConstructPoint(XCoordinate=panel_4, YCoordinate=0, ZCoordinate=0)
panel_5 = Panel(pt_2)

# ----
# Create end point
panel_6 = Panel("-1")
item = ListItem(List=panel_5, Index=panel_6, Wrap=True)
panel_7 = Panel(item)

# ----
# Title and explanatory text
panel_8 = Panel("Conversion tool")
panel_9 = Panel("Convert your ADA-CAD .wif files into 3D printer-ready .gcode. Generate and save your file to start weaving.")
separator_2 = CreateSeparator(Thickness="10", Horizontal=True, Color=RGBA(0, 0, 0, 0))
tb = CreateTextBlock(Text=panel_9, TextSize=12, Justification=0)
label_3 = CreateLabel(LabelText=panel_8, LabelSize=12, Justification=0)
separator_3 = CreateSeparator(Thickness="25", Horizontal=True, Color=RGBA(0, 0, 0, 0))
adjustelem = AdjustElementAppearance(ElementsToAdjust=tb, Foreground=ColourSwatch(SwatchColor=RGB(39, 53, 130)), Background=RGBA(0, 0, 255, 0), FontSize=12)
adjustelem_2 = AdjustElementAppearance(
    ElementsToAdjust=label_3,
    Foreground=ColourSwatch(SwatchColor=RGB(212, 219, 7)),
    Background=ColourSwatch(SwatchColor=RGB(39, 53, 130)),
    FontSize=25)
merge_3 = Merge(Data1=label_3, Data2=separator_2, Data3=tb, Data4=separator_3)

# ----
# Make window
panel_10 = Panel("Conversion tool")
font = Font(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)
launchwin = LaunchWindow(Show=Toggle(True), Name=panel_10, Width="700", Height="800", FontFamily=font, ChildStatus=0, EnableHorizScroll=False)
winprops = SetWindowProperties(
    Window=launchwin,
    StartingLocation="835,0,0",
    Theme=0,
    ShowTitleBar=Toggle(True),
    BackgroundColor=ColourSwatch(SwatchColor=RGB(255, 255, 255)),
    ScaleFactor=1)

# ----
# Add pause, text indication, automated reset
# Add start protocol: home X
start_protocol_x_home = Text("G28 X0")

# ----
# Step 2: Alter starting row
panel_11 = Panel("I want to alter the start row")
label_4 = CreateLabel(LabelText="Otherwise continue to step 3", LabelSize=8, Justification=0)
label_5 = CreateLabel(LabelText="Step 2: Check box if you want to alter the start row", LabelSize=12, Justification=0)
separator_4 = CreateSeparator(Thickness="15", Horizontal=True, Color=RGBA(0, 0, 0, 0))
checkbox = CreateCheckbox(Label=panel_11, StartingValue=False)
separator_5 = CreateSeparator(Thickness="20", Horizontal=True, Color=RGBA(0, 0, 0, 0))
separator_6 = CreateSeparator(Thickness="20", Horizontal=True, Color=RGBA(0, 0, 0, 0))
adjustelem_3 = AdjustElementAppearance(
    ElementsToAdjust=label_4,
    Foreground=ColourSwatch(SwatchColor=RGB(39, 53, 130)),
    Background=RGBA(0, 0, 255, 0),
    FontSize=10)
adjustelem_4 = AdjustElementAppearance(
    ElementsToAdjust=checkbox,
    Foreground=ColourSwatch(SwatchColor=RGB(39, 53, 130)),
    Background=RGBA(0, 0, 255, 0),
    FontSize=12)
values_2 = ValueListener(Elements=checkbox, SomeProperty=True)  # -> Values, Indices

# ----
# Step 4: Make button to save the file
panel_12 = Panel("Save file")
label_6 = CreateLabel(LabelText="Step 4: Save file", LabelSize=12, Justification=0)
button = CreateButton(ButtonName=panel_12, ButtonStyle=0)
adjustpos = AdjustElementPositioning(ElementsToAdjust=button, AbsolutePositioning=False, Width="100", Height="35")
adjustelem_5 = AdjustElementAppearance(
    ElementsToAdjust=button,
    Foreground=ColourSwatch(SwatchColor=RGB(212, 219, 7)),
    Background=ColourSwatch(SwatchColor=RGB(39, 53, 130)),
    FontSize=14)
merge_4 = Merge(Data1=label_6, Data2=button)
values_3 = ValueListener(Elements=filepicker_2, SomeProperty=True)  # -> Values, Indices
values_4 = ValueListener(Elements=button, SomeProperty=True)  # -> Values, Indices
panel_13 = Panel(values_3.Values)
panel_14 = Panel(values_4.Values)

merge_5 = Merge(Data1=label, Data2=label_5, Data3=label_2, Data4=label_6)
adjustelem_6 = AdjustElementAppearance(
    ElementsToAdjust=merge_5,
    Foreground=ColourSwatch(SwatchColor=RGB(39, 53, 130)),
    Background=RGBA(0, 0, 255, 0),
    FontSize=15)

# ----
# Human UI
panel_15 = Panel("1")

textbox = CreateTextBox(Label="Set begin row:", DefaultText=panel_15, UpdateButton=Toggle(False), showLabel=True)
adjustelem_7 = AdjustElementAppearance(
    ElementsToAdjust=textbox,
    Foreground=ColourSwatch(SwatchColor=RGB(39, 53, 130)),
    Background=RGBA(0, 0, 255, 0),
    FontSize=12)
values_5 = ValueListener(Elements=textbox, SomeProperty=True)  # -> Values, Indices
merge_6 = Merge(Data1=label_5, Data2=label_4, Data3=separator_4, Data4=checkbox, Data5=separator_5, Data6=textbox, Data7=separator_6)
hideshow = HideShowElement(ElementToHideShow=textbox, Show=values_2.Values, Collapse=True, Disable=False)

merge_7 = Merge(Data1=merge_3, Data2=merge, Data3=merge_6, Data4=merge_2, Data5=merge_4)
addelems = AddElements(Window=launchwin, Elements=flatten(merge_7), DoVLChecking=True)  # -> AddedElements, ElementNames

# ----
# Choose the starting and end line
# use toggle and sliders to set own start and/or end line
tstat = TreeStatistics(Tree=panel_3)  # -> Paths, Length, Count

subtraction = Subtraction(A=values_5.Values, B="1")

filter = StreamFilter(Gate=values_2.Values, Stream0="0", Stream1=subtraction)
dom = ConstructDomain(DomainStart=filter, DomainEnd=tstat.Count)
subset = SubList(List=tstat.Paths, Domain=dom, Wrap=Toggle(False))  # -> flatten(List), Index
branch = TreeBranch(Tree=panel_3, Path=subset.List, MaintainPaths=True)
panel_16 = Panel(branch)

# ----
# Filter locations of lifted heddles
cull_pattern = CullPattern(List=panel_5, CullPattern=panel_16)
# Combine binary plus route to create location points for printhead in the correct order
panel_17 = Panel(cull_pattern)
point = Point(panel_17)

# ----
# (Makes sure every line always starts and ends at the same locations)
tree_statistics = TreeStatistics(Tree=point)  # -> Paths, Length, Count
starting_point_2 = Point(starting_point)
end_point = Point(panel_7)
repeat_data = RepeatData(Data=end_point, Length=tree_statistics.Count)  # -> simplify(graft(Data))
repeat_data_2 = RepeatData(Data=starting_point_2, Length=tree_statistics.Count)  # -> simplify(graft(Data))

# ----
# Move points down
# (pressed points)
number_slider_2 = Slider(-5, range=-10..0)
vec = VectorXYZ(XComponent=0, YComponent=0, ZComponent=number_slider_2)  # -> Vector, Length
move = Move(Geometry=point, Motion=vec.Vector)  # -> Geometry, Transform

# ----
# Combine all points in correct order
# (input point, point moved down, point)
panel_18 = Panel("""0
1
2""")
weave = Weave(Pattern=panel_18, Stream0=point, Stream1=move.Geometry, Stream2=point, NullGaps=False)  # -> simplify(Weave)

panel_19 = Panel(weave)

# ----
# Combine points with start and
# end points for every line
merge_8 = Merge(Data1=repeat_data_2, Data2=panel_19, Data3=repeat_data)
panel_20 = Panel(merge_8)

# ----
# Build gcode
pdecon = Deconstruct(Point=panel_20)  # -> XComponent, YComponent, ZComponent
X = Text(" X")
# Build basic gcode route
g0 = Text("G0 ")
speed = Text("10000")
Y = Text(" Y")
F = Text("F")
Z = Text(" Z")
concat = Concatenate(G0=g0, F=F, speed=speed, X=X, x=pdecon.XComponent, Y=Y, y=pdecon.YComponent, Z=Z, z=pdecon.ZComponent)

panel_21 = Panel(concat)
tstat_2 = TreeStatistics(Tree=panel_21)  # -> Paths, Length, Count

# ----
# Add row indication
# The numbers correspond with the chosen begin and starting row, and start at 1
panel_22 = Panel(subset.List)
dpath = DeconstructPath(Branch=panel_22)
addition = Addition(A=dpath, B="1")  # -> flatten(Result)
panel_23 = Panel(addition)
row_indicator = Text("Row")
m117 = Text("M117")
concat_2 = Concatenate(FragmentA=m117, FragmentC=row_indicator, FragmentB=panel_23)  # -> simplify(graft(Result))
panel_24 = Panel(concat_2)

# ----
# Add pause after row is selected
extra_lines_to_allow_pausing = Text("G0 F6000 X0 Y0 Z0")
pause = Text("M25")
dup = DuplicateData(Data=pause, Number=tstat_2.Count, Order=True)  # -> simplify(graft(Data))
dup_2 = DuplicateData(Data=extra_lines_to_allow_pausing, Number=tstat_2.Count, Order=True)  # -> simplify(graft(Data))

# ----
# Add reset
panel_25 = Panel(tstat_2.Count)
panel_26 = Panel("""G0 F6000 X218.5 Y0 Z0
G0 F3000 X218.5 Y0 Z-20
G0 F6000 X218.5 Y0 Z0
G0 F6000 X169.6 Y0 Z0
G0 F3000 X169.6 Y0 Z-20
G0 F6000 X169.6 Y0 Z0
G0 F6000 X121 Y0 Z0
G0 F6000 X121 Y0 Z-20
G0 F6000 X121 Y0 Z0
G0 F6000 X75.6 Y0 Z0
G0 F3000 X75.6 Y0 Z-20
G0 F6000 X75.6 Y0 Z0
G0 F6000 X26.8 Y0 Z0
G0 F3000 X26.8 Y0 Z-20
G0 F6000 X26.8 Y0 Z0""")
dup_3 = DuplicateData(Data=panel_26, Number=panel_25, Order=True)
partition = PartitionList(List=dup_3, Size="15")  # -> simplify(Chunks)
path_mapper = PathMapper(partition, source="{a}", target="{a+1}")
panel_27 = Panel(path_mapper)

# ----
# Combine and create final gcode
# Combine all into final gcode
merge_9 = Merge(Data1=start_protocol_x_home, Data2=panel_27, Data3=panel_21, Data4=dup, Data5=dup_2, Data6=dup_2, Data7=panel_24)  # -> flatten(Result)

join = TextJoin(Text=merge_9)
panel_28 = Panel(join)

c_script = CSharpScript(path=panel_13, content=panel_28, run=panel_14)  # -> out, a; inputs path: String, content: String, run: Boolean
# ---------- c_script: C# ----------
if(run && !string.IsNullOrEmpty(path)) {
    System.IO.File.WriteAllText(path, content);
}
# ---------- end c_script ----------

# ----
# To export:
# 1. Rightclick the yellow panel
# 2. Click 'stream destination'
# 3. name the file, add .gcode, save it on the sd card
# 4. Rightclick the yellow panel
# 5. Click 'stream contents'
# 
# Now the file should be saved on the SD, get ready to weave :)
panel_29 = Panel(merge_9)
